% Simulink data dictionary EmbeddedBoardDD.sldd
% references can_messaging.sldd
% references supervisor.sldd

JointPositions = Simulink.Bus()
  position: single, Unit="deg"  % joint positions

JointVelocities = Simulink.Bus()
  velocity: single, Unit="deg/s"  % joint velocities

Targets = Simulink.Bus()
  jointpositions: Bus: JointPositions
  jointvelocities: Bus: JointVelocities
  motorcurrent: Bus: MotorCurrent
  motorvoltage: Bus: MotorVoltage

MotorCurrent = Simulink.Bus()
  current: single, Unit="A"  % motor current

MotorSensors = Simulink.Bus()
  Iabc: single[3], Unit="A"
  angle: single, Unit="deg"  % electrical angle = angle * pole_pairs
  temperature: single, Unit="degC"
  voltage: single, Unit="V"
  current: single, Unit="A"
  hallABC: uint8

ExternalFlags = Simulink.Bus()
  fault_button: boolean  % External Fault Button (1 == pressed)

MotorVoltage = Simulink.Bus()
  voltage: single, Min=-100, Max=100, Unit="%"  % motor voltage

FOCSlowInputs = Simulink.Bus()
  flags: Bus: Flags
  configurationparameters: Bus: ConfigurationParameters
  estimateddata: Bus: EstimatedData
  targets: Bus: Targets
  controlouteroutputs: Bus: ControlOuterOutputs

PIDConfig = Simulink.Bus()
  OutMax: single
  OutMin: single
  P: single
  I: single
  D: single
  N: single
  I0: single
  D0: single
  shift_factor: uint8

ControlOuterOutputs = Simulink.Bus()
  vel_en: boolean
  cur_en: boolean
  out_en: boolean
  pid_reset: boolean
  motorcurrent: Bus: MotorCurrent
  current_limiter: single, Unit="V"

MotorTemperature = Simulink.Bus()
  temperature: single, Unit="°C"  % motor temperature

EstimatedData = Simulink.Bus()
  jointvelocities: Bus: JointVelocities  % velocity
  Iq_filtered: Bus: MotorCurrent  % filtered motor current
  motor_temperature: Bus: MotorTemperature  % motor temperature

Thresholds = Simulink.Bus()
  jntPosMin: single, Unit="deg"  % It shall be greater than hardwareJntPosMin
  jntPosMax: single, Unit="deg"  % It shall be smaller than hardwareJntPosMax
  hardwareJntPosMin: single, Unit="deg"  % Imposed by hardware constraint
  hardwareJntPosMax: single, Unit="deg"  % Imposed by hardware constraint
  rotorPosMin: single, Unit="deg"  % If robotMin == rotorMax == 0, there's no check
  rotorPosMax: single, Unit="deg"  % If robotMin == rotorMax == 0, there's no check
  jntVelMax: single, Min=0, Unit="deg/s"  % Can be only non-negative
  velocityTimeout: uint32, Min=0, Unit="ms"  % Timeout on reception of velocity setpoint
    % Can be only non-negative
  motorNominalCurrents: single, Min=0, Unit="A"  % Current that can be kept for an indefinite period of time w/o damaging the motor
    % Expressed in [A] as all the internal computations are done this way
    % Can be only non-negative
  motorPeakCurrents: single, Min=0, Unit="A"  % Current that can be applied for a short period of time
    % Expressed in [A] as all the internal computations are done this way
    % Can be only non-negative
  motorOverloadCurrents: single, Min=0, Unit="A"  % Currents over this threshold can instantaneously damages the motor
    % Expressed in [A] as all the internal computations are done this way
    % Can be only non-negative
  motorPwmLimit: uint32, Min=0, Unit="1"  % Expressed in ticks
    % Max value is 32000
    % Can be only non-negative
  motorCriticalTemperature: single, Unit="°C"  % The critical temperature of the motor that triggers i2t current protection.

ConfigurationParameters = Simulink.Bus()
  motorconfig: Bus: MotorConfig
  estimationconfig: Bus: EstimationConfig
  CurLoopPID: Bus: PIDConfig
  PosLoopPID: Bus: PIDConfig
  VelLoopPID: Bus: PIDConfig
  DirLoopPID: Bus: PIDConfig
  thresholds: Bus: Thresholds
  environment_temperature: single, Unit="°C"

ControlOutputs = Simulink.Bus()
  Vq: single, Min=-100, Max=100, Unit="%"  % control effort (quadrature)
  Vabc: single[3], Min=0, Max=100, Unit="%"  % control effort (3-phases)
  Iq_fbk: Bus: MotorCurrent  % quadrature current
  Id_fbk: Bus: MotorCurrent  % direct current
  Iq_rms: Bus: MotorCurrent  % RMS of Iq
  Id_rms: Bus: MotorCurrent  % RMS of Id

EstimationConfig = Simulink.Bus()
  velocity_mode: Enum: EstimationVelocityModes
  current_rms_lambda: single, Min=0, Max=1  % Forgetting factor in [0, 1] for exponential weighting-based estimation of RMS current value

Ts_AMC_BLDC = 0.001
Ts_can_decoder = 0.001
Ts_can_encoder = 0.001
Ts_ControlOuter = 0.001
Ts_EstimationVelocity = 0.001
Ts_FilterCurrent = 0.001
Ts_SupervisorFSM_RX = 0.001
Ts_ThermalModel = 0.01
Ts_SupervisorFSM_TX = 0.001

SupplyVoltage = Simulink.Bus()
  voltage: single, Min=0, Unit="V"

MotorConfig = Simulink.Bus()
  hall_sens_offset: single, Unit="deg"  % Angular offset in degrees between the stator windings and the hall sensors.
  has_hall_sens: boolean
  has_quadrature_encoder: boolean
  has_speed_quadrature_encoder: boolean
  has_torque_sens: boolean
  use_index: boolean
  enable_verbosity: boolean
  rotor_encoder_resolution: int16
  rotor_index_offset: int16
  encoder_tolerance: uint8
  pole_pairs: uint8
  Kbemf: single
  Rphase: single
  Imin: single, Unit="A"
  Imax: single, Unit="A"
  Vmax: single, Unit="V"
  resistance: single, Unit="Ohm"
  inductance: single, Unit="uH"
  thermal_resistance: single, Unit="K/W"
  thermal_time_constant: single, Unit="s"

SensorsData = Simulink.Bus()
  jointpositions: Bus: JointPositions, Unit="deg"  % position encoders
  motorsensors: Bus: MotorSensors  % motor probes
  supplyvoltagesensors: Bus: SupplyVoltage  % supply probes

InitConfParams = Simulink.Parameter(struct(
  motorconfig=struct(
    hall_sens_offset=single(30),
    has_hall_sens=true,
    has_quadrature_encoder=true,
    has_speed_quadrature_encoder=false,
    has_torque_sens=false,
    use_index=true,
    enable_verbosity=false,
    rotor_encoder_resolution=int16(16000),
    rotor_index_offset=int16(0),
    encoder_tolerance=uint8(0),
    pole_pairs=uint8(7),
    Kbemf=single(0),
    Rphase=single(0),
    Imin=single(0),
    Imax=single(0),
    Vmax=single(24),
    resistance=single(25.9),
    inductance=single(271),
    thermal_resistance=single(16),
    thermal_time_constant=single(797.5)),
  estimationconfig=struct(velocity_mode=EstimationVelocityModes.MovingAverage, current_rms_lambda=single(0.9995)),
  CurLoopPID=struct(
    OutMax=single(0),
    OutMin=single(0),
    P=single(2),
    I=single(500),
    D=single(0),
    N=single(10),
    I0=single(0),
    D0=single(0),
    shift_factor=uint8(0)),
  PosLoopPID=struct(
    OutMax=single(0),
    OutMin=single(0),
    P=single(0),
    I=single(0),
    D=single(0),
    N=single(0),
    I0=single(0),
    D0=single(0),
    shift_factor=uint8(0)),
  VelLoopPID=struct(
    OutMax=single(0),
    OutMin=single(0),
    P=single(-3.0e-5),
    I=single(-3.0e-5),
    D=single(0),
    N=single(10),
    I0=single(0),
    D0=single(0),
    shift_factor=uint8(0)),
  DirLoopPID=struct(
    OutMax=single(0),
    OutMin=single(0),
    P=single(0),
    I=single(0),
    D=single(0),
    N=single(0),
    I0=single(0),
    D0=single(0),
    shift_factor=uint8(0)),
  thresholds=struct(
    jntPosMin=single(1),
    jntPosMax=single(359),
    hardwareJntPosMin=single(0),
    hardwareJntPosMax=single(360),
    rotorPosMin=single(0),
    rotorPosMax=single(0),
    jntVelMax=single(40000),
    velocityTimeout=uint32(10),
    motorNominalCurrents=single(2),
    motorPeakCurrents=single(5),
    motorOverloadCurrents=single(10),
    motorPwmLimit=uint32(32000),
    motorCriticalTemperature=single(70)),
  environment_temperature=single(25)), StorageClass="ExportedGlobal", Alias="InitConfParams", DataType="Bus: ConfigurationParameters")

Estimation_Temperature_Switch = false

Variant_Configurations = Simulink.VariantConfigurationData(
  struct(
    Configurations=[struct(
      Name="Configuration_Estimation_Temperature_OFF",
      Description="",
      ControlVariables=struct(Name="Estimation_Temperature_Switch", Value=false, Source="EmbeddedBoardDD.sldd")), struct(
      Name="Configuration_Estimation_Temperature_ON",
      Description="",
      ControlVariables=struct(Name="Estimation_Temperature_Switch", Value=true, Source="EmbeddedBoardDD.sldd"))],
    VariantConfigurations=[struct(
      Name="Configuration_Estimation_Temperature_OFF",
      Description="",
      ControlVariables=struct(Name="Estimation_Temperature_Switch", Value="false", Source="EmbeddedBoardDD.sldd"),
      SubModelConfigurations=[]), struct(
      Name="Configuration_Estimation_Temperature_ON",
      Description="",
      ControlVariables=struct(Name="Estimation_Temperature_Switch", Value="true", Source="EmbeddedBoardDD.sldd"),
      SubModelConfigurations=[])],
    Constraints=[],
    PreferredConfiguration="Configuration_Estimation_Temperature_OFF",
    DefaultConfigurationName="",
    DataDictionaryName="EmbeddedBoardDD.sldd",
    DataDictionarySection="Configurations",
    AreSubModelConfigurationsMigrated=true,
    ComponentConfigurationData=[],
    Version="23.2"))

Ts_ControlFOC = 4.5e-5

Flags = Simulink.Bus()
  control_mode: Enum:ControlModes  % control mode
  enable_sending_msg_status: boolean
  fault_button: boolean
  overcurrent: boolean
  enable_thermal_protection: boolean