% Simulink data dictionary amcbldc.sldd
% references can_messaging.sldd
% references embeddedBoard_common.sldd

Ts_SupervisorFSM_TX = 0.001
Ts_can_decoder = 0.001
Ts_can_encoder = 0.001
AMCBLDC_Configuration = Simulink.ConfigSet(StartTime="0", StopTime="10", Solver="FixedStepDiscrete", ProdHWDeviceType="ARM Compatible->ARM Cortex-M", SystemTargetFile="ert.tlc", TargetLang="C++")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