% Simulink data dictionary amcfoc.sldd
% references embeddedBoard_common.sldd

N_MOTORS = int32(2)

CAN_MESSAGE_BUS = Simulink.Bus()
  Extended: uint8
  Length: uint8
  Remote: uint8
  Error: uint8
  ID: uint32
  Timestamp: double
  Data: uint8[8]

AmcfocInitConf = Simulink.Parameter([struct(
  thresholds=struct(
    jntVelMax=single(60000),
    motorNominalCurrents=single(1),
    motorPeakCurrents=single(2),
    motorOverloadCurrents=single(3),
    motorPwmLimit=uint32(32000),
    motorCriticalTemperature=single(60)),
  pids=struct(
    currentPID=struct(
      type=ControlModes.Current,
      OutMax=single(100),
      OutMin=single(-100),
      P=single(2),
      I=single(500),
      D=single(0),
      N=single(0),
      I0=single(0),
      D0=single(0),
      shift_factor=uint8(0)),
    velocityPID=struct(
      type=ControlModes.Velocity,
      OutMax=single(3),
      OutMin=single(-3),
      P=single(10),
      I=single(10),
      D=single(0),
      N=single(0),
      I0=single(0),
      D0=single(0),
      shift_factor=uint8(0)),
    positionPID=struct(
      type=ControlModes.Position,
      OutMax=single(0),
      OutMin=single(0),
      P=single(0),
      I=single(0),
      D=single(0),
      N=single(0),
      I0=single(0),
      D0=single(0),
      shift_factor=uint8(0))),
  motor=struct(
    externals=struct(
      enable_verbosity=false,
      has_hall_sens=true,
      has_quadrature_encoder=false,
      has_speed_quadrature_encoder=false,
      has_temperature_sens=false,
      encoder_tolerance=uint8(0),
      pole_pairs=uint8(7),
      rotor_encoder_resolution=int16(0),
      rotor_index_offset=int16(0),
      use_index=false),
    Kbemf=single(0),
    Rphase=single(0),
    Imin=single(-3),
    Imax=single(3),
    Vmax=single(24),
    resistance=single(0),
    inductance=single(0),
    thermal_resistance=single(0),
    thermal_time_constant=single(0),
    hall_sensors_offset=single(0),
    hall_sensors_swapBC=false,
    reference_encoder=ReferenceEncoder.Motor)), struct(
  thresholds=struct(
    jntVelMax=single(60000),
    motorNominalCurrents=single(1),
    motorPeakCurrents=single(2),
    motorOverloadCurrents=single(3),
    motorPwmLimit=uint32(32000),
    motorCriticalTemperature=single(60)),
  pids=struct(
    currentPID=struct(
      type=ControlModes.Current,
      OutMax=single(100),
      OutMin=single(-100),
      P=single(2),
      I=single(500),
      D=single(0),
      N=single(0),
      I0=single(0),
      D0=single(0),
      shift_factor=uint8(0)),
    velocityPID=struct(
      type=ControlModes.Velocity,
      OutMax=single(3),
      OutMin=single(-3),
      P=single(10),
      I=single(10),
      D=single(0),
      N=single(0),
      I0=single(0),
      D0=single(0),
      shift_factor=uint8(0)),
    positionPID=struct(
      type=ControlModes.Position,
      OutMax=single(0),
      OutMin=single(0),
      P=single(0),
      I=single(0),
      D=single(0),
      N=single(0),
      I0=single(0),
      D0=single(0),
      shift_factor=uint8(0))),
  motor=struct(
    externals=struct(
      enable_verbosity=false,
      has_hall_sens=true,
      has_quadrature_encoder=false,
      has_speed_quadrature_encoder=false,
      has_temperature_sens=false,
      encoder_tolerance=uint8(0),
      pole_pairs=uint8(7),
      rotor_encoder_resolution=int16(0),
      rotor_index_offset=int16(0),
      use_index=false),
    Kbemf=single(0),
    Rphase=single(0),
    Imin=single(-3),
    Imax=single(3),
    Vmax=single(24),
    resistance=single(0),
    inductance=single(0),
    thermal_resistance=single(0),
    thermal_time_constant=single(0),
    hall_sensors_offset=single(0),
    hall_sensors_swapBC=false,
    reference_encoder=ReferenceEncoder.Motor))], StorageClass="ExportedGlobal", Alias="AmcfocInitConf", DataType="Bus: ActuatorConfiguration")