% Simulink data dictionary newBoard.sldd

MotorConfiguration = Simulink.Bus()
  has_hall_sens: boolean
  has_quadrature_encoder: boolean
  has_speed_quadrature_encoder: boolean
  has_torque_sens: boolean
  use_index: boolean
  enable_verbosity: boolean
  rotor_encoder_resolution: int16
  rotor_index_offset: int16
  encoder_tolerance: uint8
  pole_pairs: uint8
  Kbemf: single
  Rphase: single
  Imin: single, Unit="A"
  Imax: single, Unit="A"
  Vcc: single, Unit="V"
  Vmax: single, Unit="V"
  resistance: single, Unit="Ohm"
  inductance: single, Unit="uH"
  thermal_resistance: single, Unit="K/W"
  thermal_time_constant: single, Unit="s"

GlobalConfiguration = Simulink.Bus()
  estimation: Bus: EstimationConfiguration

Thresholds = Simulink.Bus()
  jntVelMax: single, Min=0, Unit="deg/s"  % Can be only non-negative
  motorNominalCurrents: single, Min=0, Unit="A"  % Current that can be kept for an indefinite period of time w/o damaging the motor
    % Expressed in [A] as all the internal computations are done this way
    % Can be only non-negative
  motorPeakCurrents: single, Min=0, Unit="A"  % Current that can be applied for a short period of time
    % Expressed in [A] as all the internal computations are done this way
    % Can be only non-negative
  motorOverloadCurrents: single, Min=0, Unit="A"  % Currents over this threshold can instantaneously damages the motor
    % Expressed in [A] as all the internal computations are done this way
    % Can be only non-negative
  motorPwmLimit: uint32, Min=0, Unit="1"  % Expressed in ticks
    % Max value is 32000
    % Can be only non-negative
  motorCriticalTemperature: single, Unit="°C"  % The critical temperature of the motor that triggers i2t current protection.

MotorSensors = Simulink.Bus()
  Iabc: single[3], Unit="A"
  angle: single, Unit="deg"  % electrical angle = angle * pole_pairs
  temperature: single, Unit="degC"
  voltage: single, Unit="V"
  current: single, Unit="A"
  hallABC: uint8

ExternalFlags = Simulink.Bus()
  fault_button: boolean  % External Fault Button (1 == pressed)

ControlOuterOutputs = Simulink.Bus()
  vel_en: boolean
  cur_en: boolean
  out_en: boolean
  pid_reset: boolean
  motorcurrent: single
  current_limiter: single, Unit="V"

Targets = Simulink.Bus()
  jointpositions: single
  jointvelocities: single
  motorcurrent: single
  motorvoltage: single

SensorsData = Simulink.Bus()
  jointpositions: single, Unit="deg"  % position encoders
  motorsensors: Bus: MotorSensors

FOCOutputs = Simulink.Bus()
  Vq: single, Min=-100, Max=100, Unit="%"  % control effort (quadrature)
  Vabc: single[3], Min=0, Max=100, Unit="%"  % control effort (3-phases)
  Iq_fbk: single  % quadrature current
  Id_fbk: single  % direct current
  Iq_rms: single  % RMS of Iq
  Id_rms: single  % RMS of Id

EstimatedData = Simulink.Bus()
  jointvelocities: single  % velocity
  Iq_filtered: single  % filtered motor current
  motor_temperature: single  % motor temperature

EstimationConfiguration = Simulink.Bus()
  environment_temperature: single
  current_rms_lambda: single
  velocity_est_mode: Enum: EstimationVelocityModes

EstimationVelocityModes = enum(DefaultValue="Disabled", AddClassNameToEnumNames=true)
  Disabled = 0
  MovingAverage = 1
  LeastSquares = 2

InitConfParams = Simulink.Parameter(struct(
  motorconfig=struct(
    has_hall_sens=true,
    has_quadrature_encoder=true,
    has_speed_quadrature_encoder=false,
    has_torque_sens=false,
    use_index=true,
    enable_verbosity=false,
    rotor_encoder_resolution=int16(16000),
    rotor_index_offset=int16(0),
    encoder_tolerance=uint8(0),
    pole_pairs=uint8(7),
    Kbemf=single(0),
    Rphase=single(0),
    Imin=single(0),
    Imax=single(0),
    Vcc=single(44),
    Vmax=single(24),
    resistance=single(25.9),
    inductance=single(271),
    thermal_resistance=single(16),
    thermal_time_constant=single(797.5)),
  estimationconfig=struct(velocity_mode=EstimationVelocityModes.MovingAverage, current_rms_lambda=single(0.9995)),
  CurLoopPID=struct(
    OutMax=single(0),
    OutMin=single(0),
    P=single(2),
    I=single(500),
    D=single(0),
    N=single(10),
    I0=single(0),
    D0=single(0),
    shift_factor=uint8(0)),
  PosLoopPID=struct(
    OutMax=single(0),
    OutMin=single(0),
    P=single(0),
    I=single(0),
    D=single(0),
    N=single(0),
    I0=single(0),
    D0=single(0),
    shift_factor=uint8(0)),
  VelLoopPID=struct(
    OutMax=single(0),
    OutMin=single(0),
    P=single(-3.0e-5),
    I=single(-3.0e-5),
    D=single(0),
    N=single(10),
    I0=single(0),
    D0=single(0),
    shift_factor=uint8(0)),
  DirLoopPID=struct(
    OutMax=single(0),
    OutMin=single(0),
    P=single(0),
    I=single(0),
    D=single(0),
    N=single(0),
    I0=single(0),
    D0=single(0),
    shift_factor=uint8(0)),
  thresholds=struct(
    jntPosMin=single(1),
    jntPosMax=single(359),
    hardwareJntPosMin=single(0),
    hardwareJntPosMax=single(360),
    rotorPosMin=single(0),
    rotorPosMax=single(0),
    jntVelMax=single(40000),
    velocityTimeout=uint32(10),
    motorNominalCurrents=single(2),
    motorPeakCurrents=single(5),
    motorOverloadCurrents=single(10),
    motorPwmLimit=uint32(32000),
    motorCriticalTemperature=single(70)),
  environment_temperature=single(25)), StorageClass="ExportedGlobal", Alias="InitConfParams", DataType="Bus: ActuatorConfiguration")

PID = Simulink.Bus()
  type: Enum:ControlModes
  OutMax: single
  OutMin: single
  P: single
  I: single
  D: single
  N: single
  I0: single
  D0: single
  shift_factor: uint8

PIDsConfiguration = Simulink.Bus()
  currentPID: Bus: PID
  velocityPID: Bus: PID
  positionPID: Bus: PID

ActuatorConfiguration = Simulink.Bus()
  thresholds: Bus: Thresholds
  pids: Bus: PIDsConfiguration
  motor: Bus: MotorConfiguration

FOCSlowInputs = Simulink.Bus()
  global_configuration: Bus: GlobalConfiguration
  actuator_configuration: Bus: ActuatorConfiguration
  estimated_data: Bus: EstimatedData
  targets: Bus: Targets
  control_outer_outputs: Bus: ControlOuterOutputs

ControlModes = enum(DefaultValue="NotConfigured", AddClassNameToEnumNames=true)
  NotConfigured = 0
  Idle = 1
  Position = 2
  PositionDirect = 3
  Current = 4
  Velocity = 5
  Voltage = 6
  Torque = 7
  HwFaultCM = 8

Flags = Simulink.Bus()
  control_mode: Enum: ControlModes  % control mode
  enable_thermal_protection: boolean

SupervisorInputLimits = Simulink.Bus()
  overload: single
  peak: single
  nominal: single
  type: Enum: ControlModes

DataInterface = Simulink.Bus()
  Element: double

SupervisorEvents = enum(DefaultValue="None", AddClassNameToEnumNames=true)
  None = 0
  SetLimit = 1
  SetControlMode = 2
  SetMotorConfig = 5
  SetPid = 3
  SetTarget = 4

SupervisorReceivedEvents = Simulink.Bus()
  targets_content: Bus: Targets
  pid_content: Bus: PID
  control_mode_content: Enum: ControlModes
  limits_content: Bus: SupervisorInputLimits
  event_type: Enum: SupervisorEvents
  motor_config_content: Bus: MotorConfiguration

BoardState = enum()
  NotConfigured = 0
  Configured = 1
  Fault = 2