% Simulink data dictionary MotionController.sldd

CTRL_LOOP_PERIOD = 0.001
velAvg = Simulink.Parameter(2, DataType="single")
Ts = 0.001

InitTrajectory = struct(
  pos_min=single(0),
  pos_max=single(0),
  vel_max=single(0),
  acc_max=single(0),
  target_pos=single(0),
  xX=single(0),
  xV=single(0),
  xA=single(0),
  xT=single(0),
  xTimer=single(0),
  bVelocityMove=false,
  target_vel=single(0),
  vX=single(0),
  vV=single(0),
  vA=single(0),
  vT=single(0),
  vTimer=single(0),
  xInvT=single(0),
  vInvT=single(0),
  xK0=single(0),
  xK1=single(0),
  xK2=single(0),
  xK3=single(0),
  vK0=single(0),
  vK1=single(0),
  vK2=single(0))

trajectoryhidParameters = Simulink.Bus()
  pos_min: single
  pos_max: single
  vel_max: single
  acc_max: single
  target_pos: single
  xX: single
  xV: single
  xA: single
  xT: single
  xTimer: single
  bVelocityMove: boolean
  target_vel: single
  vX: single
  vV: single
  vA: single
  vT: single
  vTimer: single
  xInvT: single
  vInvT: single
  xK0: single
  xK1: single
  xK2: single
  xK3: single
  vK0: single
  vK1: single
  vK2: single

MCConfiguration = Simulink.ConfigSet(StartTime="0", StopTime="1", FixedStep="0.001", Solver="FixedStepDiscrete", ProdHWDeviceType="ARM Compatible->ARM Cortex-M", SystemTargetFile="ert.tlc", TargetLang="C++")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

JointControlMode = enum()
  Idle = 0
  ForceIdle = 9
  HWFault = 1
  NotConfigured = 2
  Position = 3
  Velocity = 4
  PositionDirect = 5
  Current = 6
  Torque = 7
  OpenLoop = 8

JointFaultStates = enum()
  None = 0
  HardLimitReached = 1

KalmanFilterParameters = Simulink.Bus()
  x0: single[3]
  Q: single[3]
  R: single
  P0: single

JointParameters = Simulink.Bus()
  NofMotors: uint8  % Number of motors needed to move the joint.
  positionMin: ValueType: angle
  positionMax: ValueType: angle
  velocityMax: ValueType: velocity
  accelerationMax: ValueType: acceleration
  gearboxRatio: single
  deadZone: single
  kalmanFilterEnabled: boolean

JointState = Simulink.Bus()
  controlMode: Enum: JointControlMode
  position: ValueType: angle
  velocity: ValueType: velocity
  acceleration: ValueType: acceleration
  faultState: Enum: JointFaultStates

angle = Simulink.ValueType(DataType="single", Unit="deg", be=Simulink.BusElement(Name="a", DataType="double"))
displacement = Simulink.ValueType(DataType="single", Unit="m", be=Simulink.BusElement(Name="a", DataType="double"))
velocity = Simulink.ValueType(DataType="single", Unit="deg/s", be=Simulink.BusElement(Name="a", DataType="double"))
acceleration = Simulink.ValueType(DataType="single", Unit="deg/s^2", be=Simulink.BusElement(Name="a", DataType="double"))