% Simulink data dictionary newBoard.sldd

MotorConfiguration = Simulink.Bus()
  has_hall_sens: boolean
  has_quadrature_encoder: boolean
  has_speed_quadrature_encoder: boolean
  has_torque_sens: boolean
  use_index: boolean
  enable_verbosity: boolean
  rotor_encoder_resolution: int16
  rotor_index_offset: int16
  encoder_tolerance: uint8
  pole_pairs: uint8
  Kbemf: single
  Rphase: single
  Imin: single, Unit="A"
  Imax: single, Unit="A"
  Vcc: single, Unit="V"
  Vmax: single, Unit="V"
  resistance: single, Unit="Ohm"
  inductance: single, Unit="uH"
  thermal_resistance: single, Unit="K/W"
  thermal_time_constant: single, Unit="s"

GlobalConfiguration = Simulink.Bus()
  estimation: Bus: EstimationConfiguration

EstimationConfiguration = Simulink.Bus()
  environment_temperature: double
  current_rms_lambda: double
  velocity_est_mode: double

PID = Simulink.Bus()
  OutMax: single
  OutMin: single
  P: single
  I: single
  D: single
  N: single
  I0: single
  D0: single
  shift_factor: uint8

PIDsConfiguration = Simulink.Bus()
  position_pid: Bus: PID
  current_pid: Bus: PID
  velocity_pid: Bus: PID

Thresholds = Simulink.Bus()
  jntVelMax: single, Min=0, Unit="deg/s"  % Can be only non-negative
  motorNominalCurrents: single, Min=0, Unit="A"  % Current that can be kept for an indefinite period of time w/o damaging the motor
    % Expressed in [A] as all the internal computations are done this way
    % Can be only non-negative
  motorPeakCurrents: single, Min=0, Unit="A"  % Current that can be applied for a short period of time
    % Expressed in [A] as all the internal computations are done this way
    % Can be only non-negative
  motorOverloadCurrents: single, Min=0, Unit="A"  % Currents over this threshold can instantaneously damages the motor
    % Expressed in [A] as all the internal computations are done this way
    % Can be only non-negative
  motorPwmLimit: uint32, Min=0, Unit="1"  % Expressed in ticks
    % Max value is 32000
    % Can be only non-negative
  motorCriticalTemperature: single, Unit="°C"  % The critical temperature of the motor that triggers i2t current protection.

SupervisorEvent = enum(DefaultValue="None")
  None = -1
  SetLimit = 0
  SetConfig = 1
  SetControlMode = 2
  SetTarget = 3
  SetPid = 4

SupervisorReceivedEvents = Simulink.Bus()
  received_event: Enum: SupervisorEvent

ActuatorConfiguration = Simulink.Bus()
  pids: Bus: PIDsConfiguration
  Element: Bus: GlobalConfiguration
  estimation: Bus: EstimationConfiguration
  motor: Bus: MotorConfiguration

ControlOutputs = Simulink.Bus()
  Vq: single, Min=-100, Max=100, Unit="%"  % control effort (quadrature)
  Vabc: single[3], Min=0, Max=100, Unit="%"  % control effort (3-phases)
  Iq_fbk: Bus: MotorCurrent  % quadrature current
  Id_fbk: Bus: MotorCurrent  % direct current
  Iq_rms: Bus: MotorCurrent  % RMS of Iq
  Id_rms: Bus: MotorCurrent  % RMS of Id

FOCSlowInputs = Simulink.Bus()
  flags: Bus: Flags
  configurationparameters: Bus: ConfigurationParameters
  estimateddata: Bus: EstimatedData
  targets: Bus: Targets
  controlouteroutputs: Bus: ControlOuterOutputs

EstimatedData = Simulink.Bus()
  jointvelocities: double  % velocity
  Iq_filtered: double  % filtered motor current
  motor_temperature: double  % motor temperature

SensorsData = Simulink.Bus()
  jointpositions: double, Unit="deg"  % position encoders
  motorsensors: Bus: MotorSensors

MotorSensors = Simulink.Bus()
  Iabc: single[3], Unit="A"
  angle: single, Unit="deg"  % electrical angle = angle * pole_pairs
  temperature: single, Unit="degC"
  voltage: single, Unit="V"
  current: single, Unit="A"
  hallABC: uint8

numberOfActuators = 1