% Simulink data dictionary adc2ft.sldd

A = Simulink.Parameter(repmat(0, 6, 6), StorageClass="SimulinkGlobal", Alias="calibration_matrix", DataType="int16")
offsets = Simulink.Parameter(repmat(0, 6, 1), StorageClass="SimulinkGlobal", Alias="calibration_offsets", DataType="uint16")